# Grasshopper definition voronoy.gh (Grasshopper 1.0.7)
# plug-ins: Pufferfish, ShapeDiverForGrasshopper

width = GetNumber(Slider(2.2, range=1..3), AtLeast=1, AtMost=1, Maximum=1.797693135e+308, Minimum=-1.797693135e+308, TreeAccess=False)
height = GetNumber(Slider(2.2, range=1..3), AtLeast=1, AtMost=1, Maximum=1.797693135e+308, Minimum=-1.797693135e+308, TreeAccess=False)
close = GetBoolean(Toggle(True), AtLeast=1, AtMost=1, FalseValue="False", TreeAccess=False, TrueValue="True")
type = GetInteger(Slider(2, range=0..2), AtLeast=1, AtMost=1, Maximum=2147483647, Minimum=-2147483648, TreeAccess=False)
sddp = ShapeDiverDocumentPayload({AbsoluteTolerance=0, AngleTolerance=0, DistanceDisplayPrecision=0, GltfVersion="Gltf2", GrasshopperVersion="1.0.0007", InputGroups="{}", OutputGroups="{}", RelativeTolerance=0, RhinoVersion="7.35.23346.11001", UnitSystem=0, VersionCreated="1.16.0.0", VersionSaved="1.16.0.0"})
xz = XZPlane(Origin=Point(0, 0, 0))
rectangle = Rectangle(Plane=xz, XSize=width, YSize=height, Radius=0)  # -> Rectangle, Length
stream_filter = StreamFilter(Gate=type, Stream0=Slider(0.5, range=0..1), Stream1=Slider(0.6, range=0..1), Stream2=Slider(0.7, range=0..1))
area = Area(Geometry=rectangle.Rectangle)  # -> Area, Centroid
move2pt = MoveToPoint(Geometry=rectangle.Rectangle, PointA=area.Centroid, PointB=xz)  # -> Moved, Vector, Transform
pop2d = Populate2D(Region=move2pt.Moved, Count=Slider(80, range=80..160), Seed=Slider(1, range=1..10))
voronoi = Voronoi(Points=pop2d, Boundary=move2pt.Moved, BruteForceOverride=False)
area_2 = Area(Geometry=voronoi)  # -> Area, Centroid
scale = Scale(Geometry=voronoi, Center=area_2.Centroid, Factor=stream_filter)  # -> Geometry, Transform
merge = Merge(Data1=voronoi, Data2=scale.Geometry)
param_viewer = ParamViewer(merge)
boundary = BoundarySurfaces(Edges=merge)
facen = FaceNormals(Mesh=boundary)  # -> Centers, flatten(Normals)
boundary_2 = BoundarySurfaces(Edges=scale.Geometry)
join = BrepJoin(Breps=boundary)  # -> flatten(Breps), Closed
number_slider = Slider(0.06, range=0..0.1)
item = ListItem(List=facen.Normals, Index=0, Wrap=True)
facen_2 = FaceNormals(Mesh=boundary_2)  # -> Centers, flatten(Normals)
amp = Amplitude(Vector=item, Amplitude=number_slider)
join_2 = BrepJoin(Breps=boundary_2)  # -> flatten(Breps), Closed
item_2 = ListItem(List=facen_2.Normals, Index=0, Wrap=True)
division = Division(A=number_slider, B="2")
subtraction = Subtraction(A=division, B=".005")
amp_2 = Amplitude(Vector=item_2, Amplitude=Slider(0.01, range=0..0.1))
amp_3 = Amplitude(Vector=item_2, Amplitude=subtraction)
extr = Extrude(Base=join_2.Breps, Direction=amp_2)
extr_2 = Extrude(Base=join.Breps, Direction=amp)
mesh_brep = MeshBrep(
    Brep=extr_2,
    Settings={GridMaxCount=0, GridMinCount=16, JaggedSeams=False, MaxEdgeLength=0, MinEdgeLength=0.0001, MinTolerance=0, Refine=True, RefineAngle=0, RelativeTolerance=0.65, SimplePlanes=True, Tolerance=0})
move = Move(Geometry=extr, Motion=amp_3)  # -> Geometry, Transform
mesh_brep_2 = MeshBrep(
    Brep=move.Geometry,
    Settings={GridMaxCount=0, GridMinCount=16, JaggedSeams=False, MaxEdgeLength=0, MinEdgeLength=0.0001, MinTolerance=0, Refine=True, RefineAngle=0, RelativeTolerance=0.65, SimplePlanes=True, Tolerance=0})
mesh_join = MeshJoin(Meshes=mesh_brep)
mesh_join_2 = MeshJoin(Meshes=mesh_brep_2)
weld_mesh = WeldMesh(Mesh=mesh_join, Angle=3.141592654)
weld_mesh_2 = WeldMesh(Mesh=mesh_join_2, Angle=3.141592654)
group = Group(Objects=[weld_mesh_2, weld_mesh])
pick_n_choose = PickNChoose(Pattern=close, Stream0=weld_mesh, Stream1=group)
ungroup = Ungroup(Group=pick_n_choose)
param_viewer_2 = ParamViewer(ungroup)
mesh = Mesh(weld_mesh)
mesh_2 = Mesh(weld_mesh_2)
volume = Volume(Geometry=mesh)  # -> Volume, Centroid
volume_2 = Volume(Geometry=mesh_2)  # -> Volume, Centroid
mesh_join_3 = MeshJoin(Meshes=ungroup)
negative = Negative(Value=volume.Volume)
geometry = Geometry(mesh_join_3)
mass_addition = MassAddition(Input=[volume_2.Volume, negative])  # -> Result, PartialResults
negative_2 = Negative(Value=mass_addition.Result)

# ---- group: must be a string
uservalue = Text(negative_2)
userkey = Text("volume")

# ----
c_script = CSharpScript(geometry=geometry, userKey=userkey, userValue=uservalue)  # -> out, geoWithUserString; inputs geometry: GeometryBase, userKey: String, userValue: String
# ---------- c_script: C# ----------
    geometry.SetUserString(userKey, userValue);
   geoWithUserString = geometry;
# ---------- end c_script ----------
context_print = ContextPrint(VolumeM2=uservalue)
multiplication = Multiplication(A=mass_addition.Result, B=Slider(100000, range=0..100000))
userkey_2 = Text("weight")
division_2 = Division(A=multiplication, B="800")
division_3 = Division(A=division_2, B="2")
negative_3 = Negative(Value=division_3)
uservalue_2 = Text(negative_3)
c_script_2 = CSharpScript(geometry=c_script.geoWithUserString, userKey=userkey_2, userValue=uservalue_2)  # -> out, geoWithUserString; inputs geometry: GeometryBase, userKey: String, userValue: String; same code as c_script
context_print_2 = ContextPrint(WeightKg=uservalue_2)
userkey_3 = Text("price")
multiplication_2 = Multiplication(A=division_3, B=Slider(20, range=0..100))
negative_4 = Negative(Value=multiplication_2)
uservalue_3 = Text(negative_4)
c_script_3 = CSharpScript(geometry=c_script_2.geoWithUserString, userKey=userkey_3, userValue=uservalue_3)  # -> out, geoWithUserString; inputs geometry: GeometryBase, userKey: String, userValue: String; same code as c_script
context_print_3 = ContextPrint(Price=uservalue_3)
panel = Panel(mass_addition.Result)
panel_2 = Panel(division_3)
panel_3 = Panel(multiplication_2)
context_bake = ContextBake(CobogóWall=c_script_3.geoWithUserString)
